# Grasshopper definition read_py.gh (Grasshopper 1.0.8)
# Copyright: AMDlab
# plug-ins: RhinoCodePluginGH

pt = Point(Point(2.008734227, 5.167359455, 0))
pt_2 = Point(Point(12.52012773, 9.922034193, 4.418789393))
pt_3 = Point(Point(3.633609774, 9.807748051, 0))
pt_4 = Point(Point(6.324829981, 9.712231487, 6.113957088))
subtraction = Subtraction(A=pt_2, B=pt)
subtraction_2 = Subtraction(A=pt_4, B=pt_3)
py3 = Python3Script(script="C:\TechBlog\py_func.py")  # -> out, func; unedited script template
vdis = VectorDisplay(Anchor=pt, Vector=subtraction)
pl = PlaneNormal(Origin=pt, ZAxis=subtraction)
vdis_2 = VectorDisplay(Anchor=pt_3, Vector=subtraction_2)
py3_2 = Python3Script(func=py3.func, n=subtraction, v=subtraction_2)  # -> out, v2; inputs n: Vector3d, v: Vector3d
# ---------- py3_2: Python ----------
# r: numpy
# venv: site-packages
import numpy as np
from Rhino.Geometry import Vector3d

def to_np(vec_rg):
    return np.array([vec_rg.X, vec_rg.Y, vec_rg.Z])

def to_rg(vec_np):
    return Vector3d(vec_np[0], vec_np[1], vec_np[2])

n_np = to_np(n)
v_np = to_np(v)

v2_np = func(n_np, v_np)

v2 = to_rg(v2_np)
# ---------- end py3_2 ----------
vdis_3 = VectorDisplay(Anchor=pt_3, Vector=py3_2.v2)
